# Grasshopper definition carrara_ff.gh (Grasshopper 1.0.8)

geo = Geometry(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)
path = FilePath("C:\Users\slantis-temp\Desktop\git\carrara_ff\carrara_ff.py")
path_2 = FilePath("C:\Users\slantis-temp\Desktop\git\carrara_ff\carrara_ff.py")
file = ReadFile(File=path, PerLineParse=False)
file_2 = ReadFile(File=path_2, PerLineParse=False)
py3 = Python3Script(script=file, layer_name="00 - Carrara")  # -> out, a, raw_objs, bbox, capped_pieces, planar_pieces, labels; inputs layer_name: String; unedited script template
S = Script(Script=file_2, Layer_name="00 - Carrara")  # -> Out, A
panel = Panel(S.Out)
geo_2 = Geometry(py3.planar_pieces)
